# Grasshopper definition ur_online_control_gh_group_04.gh (Grasshopper 1.0.7)
# plug-ins: Pufferfish, ClipperComponents, Bifocals

# ---- group: Test mesh sim casting
mesh = Mesh(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)

# ---- group: Input mesh
# Polymorph part
mesh_2 = Mesh(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)

# ----
autoannotate = AutoAnnotate(enable=Toggle(True))  # inputs enable: Boolean, types: list
# ---------- autoannotate: Python ----------
"""
Adds annotations to internalized input parameters for all components on the canvas.
using the format `X=Y`. Completely reversible via toggling the `enable` input. 
Default enabled types are Boolean, Integer, Number, String, Interval, and Plane, 
connect a Value List to the `types` input to enable others.
"""
from Grasshopper.Kernel import Types, Parameters, GH_Component
from Grasshopper.Kernel.Special import GH_ValueList, GH_ValueListItem, GH_ValueListMode
this = ghenv.Component

# region RUN_ONCE_ONLY

# Crazy self-modifying hack to remove default parameters "x, y, a" if they have no wires connected
# this block of code between #region and #endregion will be commented out after the first time the code runs.

from Grasshopper.Kernel import GH_ParameterSide

reversible = False

if reversible:
    # comment out the region by surrounding it in triple quotes
    newcode = this.Code.replace("\n# region RUN_ONCE_ONLY", "\n# region RUN_ONCE_ONLY\n\"\"\"")
    newcode = newcode.replace("\n# endregion RUN_ONCE_ONLY", "\n\"\"\"# endregion RUN_ONCE_ONLY")
else:
    # cut the entire region out irreversibly
    newcode = this.Code.partition("\n# region RUN_ONCE_ONLY")[0] + this.Code.rpartition("\n# endregion RUN_ONCE_ONLY")[-1]


def callback(doc):
    for pos, pm in enumerate(list(this.Params.Input)):
        if pm.NickName in "xy" and pm.SourceCount == 0:
            this.DestroyParameter(GH_ParameterSide.Input, pos)
            this.Params.UnregisterInputParameter(pm)

    for pos, pm in enumerate(list(this.Params.Output)):
        if pm.NickName == "a" and pm.Recipients.Count == 0:
            this.DestroyParameter(GH_ParameterSide.Output, pos)
            this.Params.UnregisterOutputParameter(pm)

    if this.IsCodeInputLinked():
        this.CodeInputParam.Sources.Clear()
    this.CodeInputParam.Script_ClearPersistentData()
    this.CodeInputParam.SetPersistentData(newcode)
    this.VariableParameterMaintenance()


this.OnPingDocument().ScheduleSolution(1, callback)


def ensure_input(name, hint=None, access=0):
    if this.Params.Input.Find(lambda p: p.NickName == name):
        return

    def callback(doc):
        from Grasshopper.Kernel import GH_ParameterSide, GH_ParamAccess
        pos = this.Params.Input.Count
        pm = this.CreateParameter(GH_ParameterSide.Input, pos)
        pm.NickName = name
        default_hint = this.GetType().Assembly.GetType("GhPython.Component.NoChangeHint")()
        pm.TypeHint = default_hint if not isinstance(hint, Parameters.IGH_TypeHint) else hint
        pm.Access = GH_ParamAccess.ToObject(GH_ParamAccess, access)
        this.Params.RegisterInputParam(pm, pos)
        this.VariableParameterMaintenance()

    this.OnPingDocument().ScheduleSolution(1, callback)


ensure_input("enable", hint=Parameters.Hints.GH_BooleanHint_CS())
ensure_input("types", access=1)

# endregion RUN_ONCE_ONLY

ann_types = [Types.GH_Boolean, Types.GH_Integer, Types.GH_Number, Types.GH_String, Types.GH_Interval, Types.GH_Plane,
             Types.GH_Point, Types.GH_Vector, Types.GH_ComplexNumber, Types.GH_Colour, Types.GH_Time]
# first N types in the list to be enabled for annotation.
# connect value list for more options
default_idx = 6
# truncates the annotation if above N characters -
# prevents long strings from expanding the component width too much
maxlen = 20

this.Name = "AutoAnnotate"

types_param = this.Params.Input.Find(lambda p: p.NickName == "types")
types_param.Description = "Connect a Value List for more options"
vallist = types_param.Sources[0] if types_param.SourceCount == 1 else None
if isinstance(vallist, GH_ValueList):
    if len(ann_types) != vallist.ListItems.Count:
        # clear and rebuild the list
        vallist.ListMode = GH_ValueListMode.CheckList
        vallist.ListItems.Clear()
        for i, _type in enumerate(ann_types):
            typename = _type().TypeName
            item = GH_ValueListItem(typename, typename)
            item.Selected = (i < default_idx)
            vallist.ListItems.Insert(i, item)
        vallist.Attributes.ExpireLayout()
        vallist.Attributes.PerformLayout()
    ann_types = [t for t, b in zip(ann_types, vallist.SaveState()) if b == "Y"]
else:
    ann_types = ann_types[:default_idx]

for obj in this.OnPingDocument().Objects:
    if not isinstance(obj, GH_Component):
        continue
    has_changed = False
    for param in obj.Params.Input:
        if not hasattr(param, "PersistentData"):
            # less overhead than testing if assignable from generic type GH_PersistentParam[T]
            continue

        if isinstance(param, Parameters.Param_ScriptVariable) or param.Name == "code":
            # script variables depend on their nicknames, do not mess with them
            # also adding an exception for the "code" input of GhPython component
            continue

        try:
            assert enable
            assert param.SourceCount == 0
            assert param.PersistentDataCount == 1
            pers_data = param.PersistentData[0][0]
            assert pers_data.GetType() in ann_types
            data_repr = pers_data.ToString()
            if isinstance(pers_data, Types.GH_String):
                data_repr = '"{}"'.format(data_repr)
            if len(data_repr) > maxlen:
                data_repr = data_repr[:maxlen] + u"\u2026"  # ellipsis
            param.NickName = param.NickName.partition("=")[0] + "=" + data_repr
            has_changed = True
        except AssertionError:
            if "=" in param.NickName:
                param.NickName = param.NickName.partition("=")[0]
                has_changed = True

    if has_changed:
        obj.Attributes.ExpireLayout()
        obj.Attributes.PerformLayout()
# ---------- end autoannotate ----------

number_slider = Slider(2, range=0..10)  # disabled

# ---- group: Rotated tool test
number_slider_2 = Slider(5, range=0..10)  # disabled
crv = Curve(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)  # disabled
divdist = DivideDistance(Curve=crv, Distance=number_slider)  # -> Points, Tangents, Parameters; disabled
number_slider_3 = Slider(20, range=0..20)  # disabled
cdiv = Derivatives(Curve=crv, Parameter=divdist.Parameters)  # -> Point, FirstDerivative; disabled
circle = CircleCNR(Center=divdist.Points, Normal=cdiv.FirstDerivative, Radius=number_slider_3)  # disabled
divdist_2 = DivideDistance(Curve=circle, Distance=number_slider_2)  # -> Points, Tangents, Parameters; disabled
pl = PlaneNormal(Origin=divdist_2.Points, ZAxis=graft(cdiv.FirstDerivative))  # disabled
pt = Point(Point(0, 0, 0))  # disabled
pt_2 = Point(Point(0, 1, 0))  # disabled
vec2pt = Vector2Pt(PointA=pt, PointB=pt_2, Unitize=False)  # -> Vector, Length; disabled
number_slider_4 = Slider(90, range=0..100)  # disabled
align = AlignPlane(Plane=pl, Direction=vec2pt.Vector)  # -> Plane, Angle; disabled
prot = RotatePlane(Plane=align.Plane, Angle=degrees(number_slider_4))  # disabled

# ----
number_slider_5 = Slider(300, range=0..1000)  # disabled
vec = VectorXYZ(XComponent=number_slider_5, YComponent=number_slider_5, ZComponent=0)  # -> Vector, Length; disabled
move = Move(Geometry=prot, Motion=vec.Vector)  # -> Geometry, Transform; disabled

# ----
# test_pt
# Origin
# Safety z offset
number_slider_6 = Slider(5, range=0..5)
Z = UnitZ(Factor=number_slider_6)
pt_3 = Point(Point(0, 0, -12))
move_2 = Move(Geometry=pt_3, Motion=Z)  # -> Geometry, Transform
pt_4 = Point(Point(143.5449512, -50.24639294, 319.3127676))
xy = XYPlane(Origin=move_2.Geometry)
rotate = Rotate(Geometry=xy, Angle=degrees(Slider(0, range=0..1000)), Plane=xy)  # -> Geometry, Transform

# ----
# safe_pt
number_slider_7 = Slider(135, range=0..1000)
pt_5 = Point(Point(268.5856153, 328.9320659, 281.5630479))
xy_2 = XYPlane(Origin=pt_5)
rotate_2 = Rotate(Geometry=xy_2, Angle=degrees(number_slider_7), Plane=xy_2)  # -> Geometry, Transform

# ----
# 0a
# Check your IP address and set UR IP address
server_address = ValueList({"192.168.10.2", "192.168.10.11", "127.0.0.1"}, selected="192.168.10.11")
ur_ip = ValueList({"192.168.10.13", "192.168.10.11", "192.168.10.10", "127.0.0.1"}, selected="192.168.10.10")
server_port = Integer(30003)
globals = PythonScript(server_address=server_address, server_port=server_port, ur_ip=ur_ip)  # inputs server_port: Int32
# ---------- globals: Python ----------
from scriptcontext import sticky as st

st["server_address"] = server_address
st["server_port"] = server_port

st["ur_ip"] = ur_ip
# ---------- end globals ----------

# ----
# Check if UR is available
ping = Button()
py = PythonScript(ip=ur_ip, ping=ping)  # -> out
# ---------- py: Python ----------
from scriptcontext import sticky as st
from mini_eggshell.ur_online_control.ur_direct.utilities import is_available


guid = str(ghenv.Component.InstanceGuid)
txt_key = "txt_" + guid
if txt_key not in st:
    st[txt_key] = ""

if ping:
    
    available = is_available(ip)
    
    if available:
        st[txt_key] = "%s is up!" % ip
    else:
        st[txt_key] = "%s is down!" % ip

print st[txt_key]
# ---------- end py ----------
panel = Panel(py)

bang = Button()
panel_2 = Panel("Unload libraries")
# Tool is rotated 90 degrees CCW in reality compared to visualization
unload = PythonScript(bang=bang)
# ---------- unload: Python ----------
from compas_ghpython import unload_modules

unload_modules("compas")
unload_modules("ur_online_control")
# ---------- end unload ----------

stop = Button()
get = Button()
get_2 = Button()
pose = PythonScript(get=get_2)  # -> pose_cartesian
# ---------- pose: Python ----------
from scriptcontext import sticky as st
from mini_eggshell.ur_online_control.ur_direct import get_current_pose_cartesian

server_address = st["server_address"]
server_port = 30005
ur_ip = st["ur_ip"]
robot = st["robot"]

tool_angle_axis = list(robot.tool.tcp_frame.point) + robot.tool.tcp_frame.axis_angle_vector
print tool_angle_axis

guid = str(ghenv.Component.InstanceGuid)
pose_cartesian_key = "pose_cartesian" + guid


if get:
    st[pose_cartesian_key] = get_current_pose_cartesian(server_address, server_port, ur_ip, tool_angle_axis)

if pose_cartesian_key not in st:
    pose_cartesian = []
else:
    pose_cartesian = st[pose_cartesian_key]
# ---------- end pose ----------
stop_2 = PythonScript(stop=stop)
# ---------- stop_2: Python ----------
from scriptcontext import sticky as st
from mini_eggshell.ur_online_control.ur_direct import stop as stop_robot

ur_ip = st["ur_ip"]

if stop:
    stop_robot(ur_ip)
# ---------- end stop_2 ----------
pose_2 = PythonScript(get=get)  # -> pose_joints
# ---------- pose_2: Python ----------
from scriptcontext import sticky as st
from mini_eggshell.ur_online_control.ur_direct import get_current_pose_joints
from mini_eggshell.ur_online_control.ur.robot import BaseConfiguration

server_address = st["server_address"]
server_port = 30005
ur_ip = st["ur_ip"]
robot = st["robot"]
tool_angle_axis = list(robot.tool.tcp_frame.point) + list(robot.tool.tcp_frame.axis_angle_vector)
print tool_angle_axis

guid = str(ghenv.Component.InstanceGuid)
pose_joints_key = "pose_joints" + guid

if get:
    st[pose_joints_key] = get_current_pose_joints(server_address, server_port, ur_ip, tool_angle_axis)
    
if pose_joints_key not in st:
    pose_joints = []
else:
    pose_joints = BaseConfiguration.from_joints(st[pose_joints_key])
# ---------- end pose_2 ----------
panel_3 = Panel(pose)
panel_4 = Panel(pose_2)

# ---- group: Origin
data = Data(["79.3845", "-766.842", "-435.007", "-0.69844", "1.52248", "0.732284"])

# ----
# 0b
# Direct UR control
vertical_pose = Number([-152.427, -780.635, 855.229, -1.1958, -1.22046, -1.20201])

wrist2 = Slider(0, range=-360..360)
base = Slider(90.163, range=-360..360)
shoulder = Slider(0, range=-360..360)
elbow = Slider(-102.857, range=-360..360)
wrist1 = Slider(0, range=-360..360)
wrist3 = Slider(0, range=-360..360)
ur1_q1_q6 = Data([base, shoulder, elbow, wrist1, wrist2, wrist3])

# ----
# Measure basis:
# 1. Clear the recorded poses
# 2. Move robot to origin and press "get pose"
# 3. Move robot to point in positive x-axis and press "get pose"
# 4. Move robot to an other point in your basis and press "get pose"
# (The farer away these positions are, the better)
# 
# 5. Alternatively change the order in the component calc base
# 6. Copy output into base component
# Calculate basis
list = ValueList({"origin, pt on positive x-axis, pt in xy plane": 0, "origin, pt on positive y-axis, pt in xy plane": 1}, selected="origin, pt on positive x-axis, pt in xy plane")
clear = Button()
rec = PythonScript(msg=pose, rec=get_2, clear=clear)  # -> rec; inputs msg: list
# ---------- rec: Python ----------
from scriptcontext import sticky as st

guid = str(ghenv.Component.InstanceGuid)
recorded_key =  "recorded_" + guid
just_cleared_key = "just_cleared_" + guid

if recorded_key not in st:
    st[recorded_key] = []

if just_cleared_key not in st:
    st[just_cleared_key] = False

if clear:
    st[recorded_key] = []
    st[just_cleared_key] = True
else:
    if len(msg):
        if msg != [None] and not st[just_cleared_key] and rec:
            st[recorded_key].append(msg)
    st[just_cleared_key] = False
        


rec = st[recorded_key]

print rec
# ---------- end rec ----------
calc_base = PythonScript(poses=rec, input_type=list)  # -> out; inputs poses: list
# ---------- calc_base: Python ----------
import Rhino.Geometry as rg
import math


if len(poses) > 2:
    
    O = poses[0]
    P1 = poses[1]
    P2 = poses[2]
    
    if input_type == 0:
        # origin, pt on positive x-axis, pt in xy plane
        origin = rg.Point3d(O[0], O[1], O[2])
        pt_on_xaxis = rg.Point3d(P1[0], P1[1], P1[2])
        pt_in_xyplane = rg.Point3d(P2[0], P2[1], P2[2])
        
        xaxis = pt_on_xaxis - origin
        xaxis.Unitize()
        
        v = pt_in_xyplane - origin
        zaxis = rg.Vector3d.CrossProduct(v, xaxis)
        zaxis.Unitize()
        
        # zaxis must look up!
        if math.acos(rg.Vector3d.ZAxis * zaxis) > math.acos(rg.Vector3d.ZAxis * -zaxis):
            zaxis = -zaxis
        
        yaxis = rg.Vector3d.CrossProduct(zaxis, xaxis)
    
    elif input_type == 1:
        # origin, pt on positive y-axis, pt in xy plane
        origin = rg.Point3d(O[0], O[1], O[2])
        pt_on_yaxis = rg.Point3d(P1[0], P1[1], P1[2])
        pt_in_xyplane = rg.Point3d(P2[0], P2[1], P2[2])
        
        yaxis = pt_on_yaxis - origin
        yaxis.Unitize()
        
        v = pt_in_xyplane - origin
        zaxis = rg.Vector3d.CrossProduct(v, yaxis)
        zaxis.Unitize()
        
        # zaxis must look up!
        if math.acos(rg.Vector3d.ZAxis * zaxis) > math.acos(rg.Vector3d.ZAxis * -zaxis):
            zaxis = -zaxis
        
        xaxis = rg.Vector3d.CrossProduct(yaxis, zaxis)
        
        
    print "Copy the following into base component:"
    print " "
    print "origin = [%.2f, %.2f, %.2f]" % tuple(list(origin))
    print "xaxis = [%.5f, %.5f, %.5f]" % tuple(list(xaxis))
    print "yaxis = [%.5f, %.5f, %.5f]" % tuple(list(yaxis))
    

#print rg.Vector3d.CrossProduct(rg.Vector3d.YAxis, rg.Vector3d.ZAxis)
#print rg.Vector3d.CrossProduct(rg.Vector3d.ZAxis, rg.Vector3d.XAxis)
# ---------- end calc_base ----------
panel_5 = Panel(rec)
panel_6 = Panel(calc_base)

# ---- group: Send commands
panel_7 = Panel("move vertical")
movel = PythonScript()  # -> script
# ---------- movel: Python ----------
from scriptcontext import sticky as st

robot = st["robot"]

tool_angle_axis = list(robot.tool.tcp_frame.point) + robot.tool.tcp_frame.axis_angle_vector
x, y, z, ax, ay, az = tool_angle_axis

script = "def prog():\n"
script += "\ttextmsg(\">> program start\")\n"
script += "\tset_tcp(p%s)\n" % str([x/1000., y/1000., z/1000, ax, ay, az])
script += "\tcurrent_pose = get_forward_kin()\n"
script += "\tmovel(p[current_pose[0], current_pose[1], current_pose[2], 0, 0, 0], a=0.1, v=0.1)\n"
script += "\ttextmsg(\"<< program end\")\n"
script += "end\n"
script += "prog()\n\n"

print script
# ---------- end movel ----------
send = Button()
send_2 = Send(script=movel, send=send)
panel_8 = Panel(send_2)

panel_9 = Panel("set digital out")
value = BooleanToggle(False)
number = Slider(0, range=0..10)
digital_out = PythonScript(number=number, value=value)  # -> script; inputs number: Int32, value: Boolean
# ---------- digital_out: Python ----------
script = "def prog():\n"
script += "\ttextmsg(\">> program start\")\n"
script += "\tset_digital_out(%i, %s)\n" % (int(number), str(value))
script += "\ttextmsg(\"<< program end\")\n"
script += "end\n"
script += "prog()\n\n"

print script
# ---------- end digital_out ----------
send_3 = Button()
send_4 = Send(script=digital_out, send=send_3)
panel_10 = Panel(send_4)

# ----
pdecon = Deconstruct()  # -> XComponent, YComponent, ZComponent

# ---- group: Send commands
# move incremental in TCS
get_current_pose = Button()
list_2 = ValueList({"xaxis", "yaxis", "zaxis"}, selected="zaxis")
movel_2 = PythonScript(get=get_current_pose, step_size=Slider(5, range=-10..10), direction=list_2)  # -> script; inputs get: list
# ---------- movel_2: Python ----------
from scriptcontext import sticky as st
from compas.geometry import Frame
from compas.geometry import Point, Vector
from mini_eggshell.ur_online_control.ur_direct import get_current_pose_cartesian

server_address = st["server_address"]
server_port = 30005
ur_ip = st["ur_ip"]
robot = st["robot"]
tool_angle_axis = list(robot.tool.tcp_frame.point) + robot.tool.tcp_frame.axis_angle_vector
print tool_angle_axis

guid = str(ghenv.Component.InstanceGuid)
pose_cartesian_key = "pose_cartesian" + guid

if get:
    st[pose_cartesian_key] = get_current_pose_cartesian(server_address, server_port, ur_ip, tool_angle_axis)

if pose_cartesian_key not in st:
    pose_cartesian = []
    script = ""
else:
    pose_cartesian = st[pose_cartesian_key]

    robot = st["robot"]
    tool_angle_axis = list(robot.tool.tcp_frame.point) + robot.tool.tcp_frame.axis_angle_vector
    x, y, z, ax, ay, az = tool_angle_axis
    
    script = "def prog():\n"
    script += "\ttextmsg(\">> program start\")\n"
    script += "\tset_tcp(p%s)\n" % str([x/1000., y/1000., z/1000, ax, ay, az])
    script += "\tcurrent_pose = get_forward_kin()\n"
    
#    frame = Frame.from_pose_axis_angle_vector(pose_cartesian)
    frame = Frame.from_axis_angle_vector([ax, ay, az])
    frame.point = [x, y, z]

    if direction == "xaxis":
        next_vector = Vector(*frame.xaxis) * step_size
    elif direction == "yaxis":
        next_vector = Vector(*frame.yaxis) * step_size
    else: # direction == "zaxis":
        next_vector = Vector(*frame.zaxis) * step_size
    
    x, y, z = next_vector
    script += "\tmovel(p[current_pose[0] + %f, current_pose[1] + %f, current_pose[2] + %f, current_pose[3], current_pose[4], current_pose[5]], t=%f)\n" % (x/1000., y/1000., z/1000., step_size * 0.1)
    
    script += "\ttextmsg(\"<< program end\")\n"
    script += "end\n"
    script += "prog()\n\n"
    
    print script
# ---------- end movel_2 ----------
send_5 = Button()
send_6 = Send(script=movel_2, send=send_5)
panel_11 = Panel(send_6)

# move incremental in WCS
number_slider_8 = Slider(5, range=-10..10)
list_3 = ValueList({"xaxis", "yaxis", "zaxis"}, selected="zaxis")
movel_3 = PythonScript(step_size=number_slider_8, direction=list_3)  # -> script
# ---------- movel_3: Python ----------
from scriptcontext import sticky as st

robot = st["robot"]
tool_angle_axis = list(robot.tool.tcp_frame.point) + robot.tool.tcp_frame.axis_angle_vector
x, y, z, ax, ay, az = tool_angle_axis

script = "def prog():\n"
script += "\ttextmsg(\">> program start\")\n"
script += "\tset_tcp(p%s)\n" % str([x/1000., y/1000., z/1000, ax, ay, az])
script += "\tcurrent_pose = get_forward_kin()\n"


if direction == "xaxis":
    script += "\tmovel(p[current_pose[0] + %f, current_pose[1], current_pose[2], current_pose[3], current_pose[4], current_pose[5]], t=%f)\n" % (step_size/1000., step_size * 0.1)

elif direction == "yaxis":
    script += "\tmovel(p[current_pose[0], current_pose[1] + %f, current_pose[2], current_pose[3], current_pose[4], current_pose[5]], t=%f)\n" % (step_size/1000., step_size * 0.1)

else: # direction == "zaxis":
    script += "\tmovel(p[current_pose[0], current_pose[1], current_pose[2] + %f, current_pose[3], current_pose[4], current_pose[5]], t=%f)\n" % (step_size/1000., step_size * 0.1)

script += "\ttextmsg(\"<< program end\")\n"
script += "end\n"
script += "prog()\n\n"

print script
# ---------- end movel_3 ----------
send_7 = Button()
send_8 = Send(script=movel_3, send=send_7)
panel_12 = Panel(send_8)

# ---- group: Check the right order of the points
# Horisontally sliced tree, 2 branches, region union
move_amount_in_x_per_layer_mm = Slider(1.5, range=0..10)  # disabled
curve_number_to_move_sidewards = Slider(5, range=0..100)  # disabled
distance_between_points = Slider(5, range=0..100)  # disabled
amount_of_layers = Slider(40, range=0..1000)  # disabled
number_slider_9 = Slider(200, range=0..1000)  # disabled
number_slider_10 = Slider(260, range=0..1000)  # disabled
number_slider_11 = Slider(200, range=0..1000)  # disabled
layer_height = Slider(3, range=0..10)  # disabled
radius = Slider(40, range=0..1000)  # disabled
pt_6 = ConstructPoint(XCoordinate=number_slider_9, YCoordinate=number_slider_11, ZCoordinate=0)  # disabled
pt_7 = ConstructPoint(XCoordinate=number_slider_10, YCoordinate=number_slider_11, ZCoordinate=0)  # disabled
circle_2 = CircleCNR(Center=pt_6, Normal=Vector(0, 0, 1), Radius=radius)  # disabled
circle_3 = CircleCNR(Center=pt_7, Normal=Vector(0, 0, 1), Radius=radius)  # disabled
series = Series(Start=0, Step=layer_height, Count=amount_of_layers)  # disabled
Z_2 = UnitZ(Factor=series)  # disabled
move_3 = Move(Geometry=graft(circle_2), Motion=Z_2)  # -> Geometry, Transform; disabled
move_4 = Move(Geometry=graft(circle_3), Motion=Z_2)  # -> Geometry, Transform; disabled
split = SplitList(List=move_3.Geometry, Index=curve_number_to_move_sidewards)  # -> ListA, ListB; disabled
split_2 = SplitList(List=move_4.Geometry, Index=curve_number_to_move_sidewards)  # -> ListA, ListB; disabled
crv_2 = Curve(split.ListA)  # disabled
crv_3 = Curve(split.ListB)  # disabled
crv_4 = Curve(split_2.ListA)  # disabled
crv_5 = Curve(split_2.ListB)  # disabled
lng = ListLength(List=crv_5)  # disabled
lng_2 = ListLength(List=crv_3)  # disabled
series_2 = Series(Start=0, Step=move_amount_in_x_per_layer_mm, Count=lng_2)  # disabled
series_3 = Series(Start=0, Step=move_amount_in_x_per_layer_mm, Count=lng)  # disabled
X = UnitX(Factor=series_2)  # disabled
X_2 = UnitX(Factor=series_3)  # disabled
rev = Reverse(Vector=X)  # disabled
move_5 = Move(Geometry=crv_5, Motion=X_2)  # -> Geometry, Transform; disabled
move_6 = Move(Geometry=crv_3, Motion=rev)  # -> Geometry, Transform; disabled
merge = Merge(Data1=crv_4, Data2=move_5.Geometry)  # -> flatten(Result); disabled
merge_2 = Merge(Data1=crv_2, Data2=move_6.Geometry)  # -> flatten(Result); disabled
crv_6 = Curve(graft(merge))  # disabled
crv_7 = Curve(graft(merge_2))  # disabled
merge_3 = Merge(Data1=crv_7, Data2=crv_6)  # disabled
runion = RegionUnion(Curves=merge_3)  # disabled
isace = IsArcCircleEllipse(Curve=runion, Tolerance=1e-12)  # -> Arc, Circle, Ellipse; disabled
dispatch = Dispatch(List=runion, DispatchPattern=isace.Circle)  # -> ListA, ListB; disabled
item = ListItem(List=dispatch.ListA, Index=0, WTrue=True)  # -> Item, Item1; disabled
area = Area(Geometry=item.Item)  # -> Area, Centroid; disabled
area_2 = Area(Geometry=item.Item1)  # -> Area, Centroid; disabled
avr = Average(Input=[area.Centroid, area_2.Centroid])  # disabled
crv_cp = CurveClosestPoint(Point=avr, Curve=dispatch.ListA)  # -> Point, Parameter, Distance; disabled
clean = CleanTree(RemoveNulls=True, RemoveInvalid=True, RemoveEmpty=True, Tree=dispatch.ListB)  # disabled

# ---- group: Check the right order of the points / Gives errors because of nulls but is OK
# Gives warning
# because of nulls but is OK
seam = Seam(Curve=dispatch.ListA, Seam=crv_cp.Parameter)  # -> simplify(graft(Curve)); disabled

# ----
# 3Branch-Rotate+SImple-No Test
number_slider_12 = Slider(180, range=0..1000)  # disabled
xz_plane = XZPlane(Origin=Point(0, 0, 0))  # disabled
brep = Brep(<brep referenced from the Rhino model>)  # disabled
panel_13 = Panel("2")  # disabled
point = Point(Point(226.7086963, 94.22146647, 5))  # disabled
brep_2 = Brep(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)  # disabled
rotate_3 = Rotate(Geometry=brep_2, Angle=degrees(number_slider_12), Plane=xz_plane)  # -> Geometry, Transform; disabled
brep_3 = Brep([rotate_3.Geometry, brep_2])  # disabled
scale = Scale(Geometry=brep, Center=point, Factor=panel_13)  # -> Geometry, Transform; disabled
slice = BooleanToggle(True)  # disabled
layer_height_mm = Slider(2, range=0..10)  # disabled
number_slider_13 = Slider(10, range=0..10)  # disabled
number_slider_14 = Slider(8175, range=0..9000)  # disabled
point_2 = Point(<point referenced from the Rhino model>)  # disabled

# ---- group: input_geometry
geo = Geometry(brep)  # disabled

# ---- group: Setup geometry
height = Slider(150, range=0..1000)  # disabled
radius_pipe = Slider(20, range=0..100)  # disabled
# Triple branches, Nizar's setup
point_3 = Point(Point(162.5565163, 6.469084979, 0))  # disabled
unit_z = UnitZ(Factor=height)  # disabled
move_7 = Move(Geometry=point_3, Motion=unit_z)  # -> Geometry, Transform; disabled
number_slider_15 = Slider(3, range=0..10)  # disabled
number_slider_16 = Slider(90, range=0..100)  # disabled
number_slider_17 = Slider(5, range=0..10)  # disabled
boolean_toggle = BooleanToggle(False)  # disabled
circle_4 = Circle(Plane=point_3, Radius=number_slider_16)  # disabled
unit_z_2 = UnitZ(Factor=number_slider_17)  # disabled
move_8 = Move(Geometry=circle_4, Motion=unit_z_2)  # -> Geometry, Transform; disabled
surface = Surface(move_8.Geometry)  # disabled

# ----
# 4Branch-Simple-
point_4 = Point(Point(7315.138414, -428.7410793, 5))  # disabled
panel_14 = Panel("2")  # disabled
brep_4 = Brep(<brep referenced from the Rhino model>)  # disabled
scale_2 = Scale(Geometry=brep_4, Center=point_4, Factor=panel_14)  # -> Geometry, Transform; disabled
distance_between_points_mm = Slider(10, range=5..50)  # disabled
layer_height_mm_2 = Slider(3, range=0..10)  # disabled
slice_2 = BooleanToggle(True)  # disabled
number_slider_18 = Slider(0, range=0..100)  # disabled
point_5 = Point(<point referenced from the Rhino model>)  # disabled

# ---- group: input_geometry
geo_2 = Geometry(brep_4)  # disabled

# ----
division = Division(A2=2, B3=3)  # disabled
multiplication = Multiplication(A=height, B=division)  # disabled
panel_15 = Panel("0")  # disabled
bool = Boolean(panel_15)  # disabled

# ----
# Angled circles, minimize clay buildup
number_slider_19 = Slider(40, range=0..100)
layer_height_control_of_bend = Slider(2, range=0..10)
max_angle_curve = Slider(45, range=0..100)
divide_curve_by_length = Slider(5, range=0..100)
shatter_control = Slider(0.2, range=0..1)
pt_8 = Point(Point(0, 0, 0))
amount_of_circles_on_top_of_bend = Slider(10, range=0..100)
bool_2 = Boolean("1")
bool_3 = Boolean("0")

slicer = GhPythonScript(slice=slice_2, input_geometry=geo_2, layer_height=layer_height_mm_2, distance_between_points=distance_between_points_mm)  # -> out, crvs, pts; disabled
# ---------- slicer: Python ----------
__author__ = "joburger"
__version__ = "2019.10.28"

import Rhino
import Rhino.Geometry as rg

import mini_eggshell.slicer.simple_slicer
reload(mini_eggshell.slicer.simple_slicer)

slicer = mini_eggshell.slicer.simple_slicer.Slicer(layer_height, distance_between_points)

if slice:
    if str(input_geometry.ObjectType) == "Mesh":
        print "Input geometry is of Mesh type"  
        crvs = slicer.create_contour_curves_from_mesh(input_geometry)
    elif str(input_geometry.ObjectType) == "Brep":
        print "Input geometry is of Brep type"
        crvs = slicer.create_contour_curves_from_brep(input_geometry)
    else:
        print "Input geometry not supported"
    
    pts = slicer.divide_curves_in_points()
# ---------- end slicer ----------

# ---- group: output_curves
crv_8 = Curve(slicer.crvs)  # disabled

# ---- group: output_points
pt_9 = Point(slicer.pts)  # disabled

# ----
point_order = PointOrder(Points=pt_9)  # disabled
list_item = ListItem(List=pt_9, Index=number_slider_18, WrapTrue=True)  # disabled
move_to_point = MoveToPoint(Geometry=pt_9, PointA=list_item, PointB=point_5)  # -> Moved, Vector, Transform; disabled

number_slider_20 = Slider(2000, range=0..10000)  # disabled
point_6 = Point(move_to_point.Moved)  # disabled
split_list = SplitList(List=point_6, Index=number_slider_20)  # -> ListA, ListB; disabled
split_list_2 = SplitList(List=split_list.ListB, Index=number_slider_20)  # -> ListA, ListB; disabled
split_list_3 = SplitList(List=split_list_2.ListB, Index=number_slider_20)  # -> ListA, ListB; disabled

# ---- group: Setup circles
circle_5 = CircleCNR(Center=pt_8, Normal=Vector(0, 0, 1), Radius=number_slider_19)
division_2 = Division(A=max_angle_curve, B=layer_height_control_of_bend)
series_4 = Series(Start=0, Step=layer_height_control_of_bend, Count=division_2)

# ----
slicer_2 = GhPythonScript(slice=slice, input_geometry=geo, layer_height=layer_height_mm, distance_between_points=number_slider_13)  # -> out, crvs, pts; disabled; same code as slicer

# ---- group: output_curves
crv_9 = Curve(slicer_2.crvs)  # disabled

# ---- group: output_points
pt_10 = Point(slicer_2.pts)  # disabled

# ----
point_order_2 = PointOrder(Points=pt_10)  # disabled
list_item_2 = ListItem(List=pt_10, Index=number_slider_14, WrapTrue=True)  # disabled
move_to_point_2 = MoveToPoint(Geometry=pt_10, PointA=list_item_2, PointB=point)  # -> Moved, Vector, Transform; disabled

number_slider_21 = Slider(2000, range=0..10000)  # disabled
point_7 = Point(move_to_point_2.Moved)  # disabled
split_list_4 = SplitList(List=point_7, Index=number_slider_21)  # -> ListA, ListB; disabled
split_list_5 = SplitList(List=split_list_4.ListB, Index=number_slider_21)  # -> ListA, ListB; disabled
split_list_6 = SplitList(List=split_list_5.ListB, Index=number_slider_21)  # -> ListA, ListB; disabled

# ---- group: Setup geometry (continued)
circle_6 = Circle(Plane=move_7.Geometry, Radius=multiplication)  # disabled
divide_curve = DivideCurve(Curve=circle_6, Count=number_slider_15, KinksFalse=False)  # -> Points, Tangents, Parameters; disabled
line = Line(StartPoint=point_3, EndPoint=divide_curve.Points)  # -> flatten(Line); disabled

list_item_3 = ListItem(List=line, Index0=0, WrapTrue=True)  # -> Item, Item1, Item2; disabled
curve = Curve(list_item_3.Item2)  # disabled
flip_curve = FlipCurve(Curve=line, Guide=curve)  # -> Curve, Flag; disabled

pipe = Pipe(Curve=flip_curve.Curve, Radius=radius_pipe, Caps=boolean_toggle)  # -> flatten(Pipe); disabled
solid_union = SolidUnion(Breps=pipe)  # disabled
brep_5 = Brep(solid_union)  # disabled
solid_difference = SolidDifference(BrepsA=brep_5, BrepsB=surface)  # disabled
brep_6 = Brep(solid_difference)  # disabled

# ----
deconstruct_brep = DeconstructBrep(Brep=brep_6)  # -> Faces, Edges, Vertices; disabled
number_slider_22 = Slider(7, range=0..100)  # disabled
surface_2 = Surface(deconstruct_brep.Faces)  # disabled
curve_2 = Curve(deconstruct_brep.Edges)  # disabled
point_8 = Point(deconstruct_brep.Vertices)  # disabled
number_slider_23 = Slider(120, range=0..1000)  # disabled
ghpython_script = GhPythonScript(pts=point_8, z_threshold=number_slider_22)  # -> out, new_pt; inputs pts: list; disabled
# ---------- ghpython_script: Python ----------
__author__ = "admin"
__version__ = "2019.11.12"

import rhinoscriptsyntax as rs
import Rhino.Geometry as rg

new_pts = []

for i in range(len(pts)):
    x,y,z = rs.coerce3dpoint(pts[i])
    if 75 > z > 70 :
      new_pt = rg.Point3d(x,y,z+z_threshold)
# ---------- end ghpython_script ----------
circle_7 = Circle(Plane=ghpython_script.new_pt, Radius=number_slider_23)  # disabled

point_on_curve = PointOnCurve(line, parameter=0.212)  # disabled
plane = Plane(point_on_curve)  # disabled
line_plane = LinePlane(Line=line, Plane=plane)  # -> Point, ParamL, ParamP; disabled
end_points = EndPoints(Curve=line)  # -> Start, End; disabled
line_2 = Line(StartPoint=line_plane.Point, EndPoint=end_points.End)  # disabled

split_brep = SplitBrep(Brep=brep_6, Cutter=circle_7)  # disabled
list_item_4 = ListItem(List=split_brep, Index0=0, WrapTrue=True)  # -> Item, Item1; disabled
brep_7 = Brep(list_item_4.Item1)  # disabled

# ---- group: input_geometry
geo_3 = Geometry(brep_7)  # disabled

# ----
layer_height_mm_3 = Slider(2, range=0..10)  # disabled
distance_between_points_mm_2 = Slider(5, range=1..40)  # disabled
slice_3 = BooleanToggle(True)  # disabled
slicer_3 = GhPythonScript(
    slice=slice_3,
    input_geometry=geo_3,
    layer_height=layer_height_mm_3,
    distance_between_points=distance_between_points_mm_2)  # -> out, crvs, pts; disabled; same code as slicer

# ---- group: output_points
pt_11 = Point(slicer_3.pts)  # disabled

# ---- group: output_curves
crv_10 = Curve(slicer_3.crvs)  # disabled

# ----
divide_length = DivideLength(Curve=line_2, Length=layer_height_mm_3)  # -> Points, Tangents, Parameters; disabled
explode_tree = ExplodeTree(Data=divide_length.Points)  # -> Branch0, Branch1, Branch2; disabled
list_length = ListLength(List=explode_tree.Branch0)  # disabled
list_length_2 = ListLength(List=explode_tree.Branch1)  # disabled
list_length_3 = ListLength(List=explode_tree.Branch2)  # disabled
merge_4 = Merge(Data1=list_length, Data2=list_length_2, Data3=list_length_3)  # disabled

area_3 = Area(Geometry=circle_5)  # -> Area, Centroid
rotate_4 = Rotate(Geometry=circle_5, Angle=degrees(Slider(180, range=0..1000)), Plane=area_3.Centroid)  # -> Geometry, Transform
end = EndPoints(Curve=circle_5)  # -> Start, End

# ---- group: Setup circles (continued)
end_2 = EndPoints(Curve=rotate_4.Geometry)  # -> Start, End
xz = XZPlane(Origin=end_2.End)
rotate_5 = Rotate(Geometry=circle_5, Angle=degrees(series_4), Plane=xz)  # -> Geometry, Transform

# ---- group: Calculate layerheight
crv_11 = Curve(rotate_5.Geometry)
curvepoint = PointOnCurve(crv_11, parameter=0.5)
python = GhPythonScript(points=curvepoint)  # -> out, a; inputs points: list of Point3d
# ---------- python: Python ----------
__author__ = "a"
__version__ = "2019.11.11"

import Rhino.Geometry as rg

dists = []

for i, pt in enumerate(points):
    if i < len(points)-1:
        dists.append(pt.DistanceTo(points[i+1]))
        
a = dists
# ---------- end python ----------
avr_2 = Average(Input=python.a)
panel_16 = Panel(avr_2)

# ----
division_3 = Division(A=shatter_control, B=division_2)
neg = Negative(Value=division_3)
series_5 = Series(Start=0.5, Step=neg, Count=division_2)  # -> graft(Series)
series_6 = Series(Start=0.5, Step=division_3, Count=division_2)  # -> graft(Series)
weave = Weave(Pattern=[0, 1], Stream0=series_5, Stream1=series_6, NullGaps=False)
shatter = Shatter(Curve=reparameterize(graft(rotate_5.Geometry)), Parameters=weave)
len = Length(Curve=shatter)
sort = SortList(Keys=len, ValuesA=shatter)  # -> Keys, reverse(ValuesA)

# ---- group: Create frames
item_2 = ListItem(List=sort.ValuesA, Index=0, WTrue=True)
end_3 = EndPoints(Curve=item_2)  # -> Start, End
curvepoint_2 = PointOnCurve(item_2, parameter=0.5)
pl_3pt = Plane3Pt(PointA=curvepoint_2, PointB=end_3.End, PointC=end_3.Start)

# ---- group: Check the right order of the points (continued)
clean_2 = CleanTree(RemoveNulls=True, RemoveInvalid=True, RemoveEmpty=True, Tree=seam)  # disabled
merge_5 = Merge(Data1=clean_2, Data2=simplify(clean))  # disabled

number_slider_24 = Slider(990, range=0..1000)  # disabled
divdist_3 = DivideDistance(Curve=merge_5, Distance=distance_between_points)  # -> simplify(Points), Tangents, Parameters; disabled
item_3 = ListItem(List=flatten(divdist_3.Points), Index=number_slider_24, WTrue=True)  # disabled

# ---- group: Check the right order of the points / Base
# Base
path_mapper = PathMapper(divdist_3.Points, source="{a;0}", target="{a}")  # disabled

# ---- group: Check the right order of the points / Tubes
# Tubes
path_mapper_2 = PathMapper(divdist_3.Points, source="{a;b;0}", target="{a;b}")  # disabled

# ---- group: Check the right order of the points (continued)
merge_6 = Merge(Data1=path_mapper, Data2=path_mapper_2)  # disabled

# ----
pt_12 = Point(merge_6)  # disabled

# ----
# Travel every first pt in branches
panel_17 = Panel("0")  # disabled
panel_18 = Panel("1")  # disabled
lng_3 = ListLength(List=path_mapper_2)  # disabled
lng_4 = ListLength(List=path_mapper)  # disabled
bool_4 = Boolean(panel_17)  # disabled
bool_5 = Boolean(panel_18)  # disabled
repeat = RepeatData(Data=bool_4, Length=lng_4)  # -> simplify(Data); disabled
repeat_2 = RepeatData(Data=bool_4, Length=expr("x-1", lng_3))  # disabled
ins = InsertItems(List=repeat_2, Item=bool_5, Indices=0, WTrue=True)  # -> simplify(List); disabled
merge_7 = Merge(Data1=repeat, Data2=ins)  # disabled

cull = CullPattern(List=pt_12, CullPattern=[False, False, True, True])  # disabled

split_3 = SplitTree(Data=pl_3pt, Masks=flatten("{0;0;0;0}"))  # -> Positive, Negative
divlength = DivideLength(Curve=simplify(sort.ValuesA), Length=divide_curve_by_length)  # -> Points, Tangents, Parameters
split_4 = SplitTree(Data=divlength.Points, Masks=flatten("{*;(1, 2, ...)}"))  # -> Positive, Negative

# ---- group: Fix first plane
xy_3 = XYPlane(Origin=Point(0, 0, 0))
prot_2 = RotatePlane(Plane=xy_3, Angle=degrees(Slider(90, range=0..100)))
deplane = DeconstructPlane(Plane=prot_2)  # -> Origin, XAxis, YAxis, ZAxis
pl_2 = PlaneNormal(Origin=deplane.Origin, ZAxis=deplane.YAxis)
rotate_6 = Rotate(Geometry=prot_2, Angle=degrees(Slider(180, range=0..1000)), Plane=pl_2)  # -> Geometry, Transform
replace = ReplaceItems(List=split_3.Positive, Item=rotate_6.Geometry, Indices=0, WFalse=False)  # -> simplify(List)
path_mapper_3 = PathMapper(replace, source="{0;0;0;0;0}", target="{0}")

# ----
merge_8 = Merge(Data1=simplify(split_3.Negative), Data2=path_mapper_3)  # -> simplify(Result)
pl_origin = PlaneOrigin(Base=merge_8, Origin=split_4.Positive)
pl_origin_2 = PlaneOrigin(Base=merge_8, Origin=split_4.Negative)
merge_9 = Merge(Data1=pl_origin_2, Data2=pl_origin)
lng_5 = ListLength(List=pl_origin_2)
lng_6 = ListLength(List=pl_origin)
prot_3 = RotatePlane(Plane=merge_9, Angle=degrees(Slider(0, range=-90..90)))
order = PointOrder(Points=prot_3)
repeat_3 = RepeatData(Data=bool_3, Length=lng_5)
repeat_4 = RepeatData(Data=bool_2, Length=lng_6)
merge_10 = Merge(Data1=repeat_3, Data2=repeat_4)  # -> simplify(Result)

# ---- group: Hotfix
split_5 = SplitTree(Data=prot_3, Masks=flatten("{0;0}"))  # -> Positive, Negative
deplane_2 = DeconstructPlane(Plane=split_5.Positive)  # -> Origin, XAxis, YAxis, ZAxis
pl_3 = PlaneNormal(Origin=deplane_2.Origin, ZAxis=deplane_2.YAxis)
rotate_7 = Rotate(Geometry=split_5.Positive, Angle=degrees(Slider(180, range=0..1000)), Plane=pl_3)  # -> Geometry, Transform
prot_4 = RotatePlane(Plane=rotate_7.Geometry, Angle=degrees(Slider(90, range=0..100)))
deplane_3 = DeconstructPlane(Plane=rotate_7.Geometry)  # -> Origin, XAxis, YAxis, ZAxis
merge_11 = Merge(Data1=prot_4, Data2=split_5.Negative)
vdis = VectorDisplay(Anchor=deplane_3.Origin, Vector=deplane_3.ZAxis)

# ----
cull_i = CullIndex(List=merge_11, Indices=-1, WTrue=True)
cull_i_2 = CullIndex(List=merge_10, Indices=-1, WTrue=True)

# ---- group: Setup location
X_3 = UnitX(Factor=Slider(250, range=0..800))
Y = UnitY(Factor=Slider(200, range=0..300))
move_9 = Move(Geometry=flatten(cull_i), Motion=X_3)  # -> Geometry, Transform
move_10 = Move(Geometry=move_9.Geometry, Motion=Y)  # -> Geometry, Transform

# ---- group: Change number to resume print
split_6 = SplitList(List=move_10.Geometry, Index=Slider(0, range=0..10000))  # -> ListA, ListB

# ----
# Nizar slicer
# Generate base
perp_frames = PerpFrames(Curve=graft(line_2), Count=merge_4, AlignTrue=True)  # -> Frames, Parameters; disabled
circle_8 = Circle(Plane=perp_frames.Frames, Radius=radius_pipe)  # disabled
list_item_5 = ListItem(List=perp_frames.Frames, Index0=0, WrapTrue=True)  # disabled
divide_length_2 = DivideLength(Curve=crv_10, Length=distance_between_points_mm_2)  # -> Points, Tangents, Parameters; disabled

# ----
# Rotate first circle
list_item_6 = ListItem(List=crv_10, Index0=0, WrapTrue=True)  # disabled
boundary_surfaces = BoundarySurfaces(Edges=list_item_6)  # disabled
area_4 = Area(Geometry=boundary_surfaces)  # -> Area, Centroid; disabled

# ---- group: Adjust seam
curve_closest_point = CurveClosestPoint(Point=area_4.Centroid, Curve=circle_8)  # -> Point, Parameter, Distance; disabled
number_slider_25 = Slider(53, range=0..60)  # disabled
seam_2 = Seam(Curve=circle_8, Seam=curve_closest_point.Parameter)  # disabled
end_points_2 = EndPoints(Curve=seam_2)  # -> Start, End; disabled
list_item_7 = ListItem(List=seam_2, Index=number_slider_25, WrapTrue=True)  # disabled

# ----
item_4 = ListItem(List=seam_2, Index=0, WTrue=True)  # disabled
item_5 = ListItem(List=perp_frames.Frames, Index=0, WTrue=True)  # disabled
area_5 = Area(Geometry=item_4)  # -> Area, Centroid; disabled
number_slider_26 = Slider(180, range=0..1000)  # disabled
pl_origin_3 = PlaneOrigin(Base=item_5, Origin=area_5.Centroid)  # disabled
rotate_8 = Rotate(Geometry=item_4, Angle=degrees(number_slider_26), Plane=pl_origin_3)  # -> Geometry, Transform; disabled
ins_2 = InsertItems(List=seam_2, Item=rotate_8.Geometry, Indices=1, WTrue=True)  # disabled

divide_length_3 = DivideLength(Curve=ins_2, Length=distance_between_points_mm_2)  # -> simplify(Points), Tangents, Parameters; disabled

# ---- group: Add safe_pt
bounding_box = BoundingBox(Content=brep_6, PlaneWorldXY=PlaneXY(0, 0, 0))  # -> Box, Box_2; disabled
deconstruct_box = DeconstructBox(Box=bounding_box.Box_2)  # -> Plane, X, Y, Z; disabled
deconstruct_domain = DeconstructDomain(Domain=deconstruct_box.Z)  # -> Start, End; disabled
multiplication_2 = Multiplication(A=deconstruct_domain.End, B11=1.1)  # disabled
unit_z_3 = UnitZ(Factor=multiplication_2)  # disabled
move_11 = Move(Geometry=area_4.Centroid, Motion=unit_z_3)  # -> Geometry, Transform; disabled
trim_tree = TrimTree(Tree=divide_length_3.Points, Depth1=1)  # disabled
panel_19 = Panel("-1")  # disabled

# ---- group: Add safe_pt / Safe pt
point_9 = Point(move_11.Geometry)  # disabled

# ---- group: Add safe_pt (continued)
insert_items = InsertItems(List=trim_tree, Item=point_9, Indices=panel_19, WrapTrue=True)  # disabled

# ---- group: Limit height tubes
pl_origin_4 = PlaneOrigin(Base=simplify(perp_frames.Frames), Origin=insert_items)  # -> simplify(Plane); disabled
prot_5 = RotatePlane(Plane=pl_origin_4, Angle=degrees(-90))  # disabled
number_slider_27 = Slider(1000, range=0..10000)  # disabled
split_7 = SplitList(List=prot_5, Index=number_slider_27)  # -> ListA, ListB; disabled
pln = Plane(simplify(split_7.ListA))  # disabled

# ----
circle_9 = Circle(Plane=list_item_5, Radius=radius_pipe)  # disabled
surface_3 = Surface(circle_9)  # disabled
extrude = Extrude(Base=flatten(surface_3), Direction=line_2)  # disabled

# ---- group: Triangle between tubes
crv_12 = Curve(circle_9)  # disabled
area_6 = Area(Geometry=crv_12)  # -> Area, Centroid; disabled
avr_3 = Average(Input=flatten(area_6.Centroid))  # disabled
crv_cp_2 = CurveClosestPoint(Point=avr_3, Curve=crv_12)  # -> Point, Parameter, Distance; disabled
number_slider_28 = Slider(45, range=0..100)  # disabled
seam_3 = Seam(Curve=crv_12, Seam=crv_cp_2.Parameter)  # disabled
end_4 = EndPoints(Curve=seam_3)  # -> Start, End; disabled
neg_2 = Negative(Value=number_slider_28)  # disabled
rotate_9 = Rotate(Geometry=end_4.Start, Angle=degrees([number_slider_28, neg_2]), Plane=list_item_5)  # -> Geometry, Transform; disabled
conmesh = ConstructMesh(Vertices=flatten(rotate_9.Geometry), Faces={A=0, B=1, C=2, D=3})  # disabled
number_slider_29 = Slider(11, range=0..20)  # disabled
medges = MeshEdges(Mesh=conmesh)  # -> NakedEdges, InteriorEdges, NonManifoldEdges; disabled
join = JoinCurves(Curves=medges.NakedEdges, Preserve=False)  # disabled
series_7 = Series(Start=0, Step=expr("x*.75", layer_height_mm_3), Count=number_slider_29)  # disabled
polyoffset = PolylineOffset(
    Polylines=join,
    Distance=series_7,
    PlnNullPlane=Plane(origin=(0, 0, 0), x=(0, 0, 0), y=(0, 0, 0)),
    Tolerance=0.01,
    ClosedFillet=1,
    OpenFillet=1,
    Miter=2)  # -> Contour, Holes; disabled
crv_13 = Curve(polyoffset.Holes)  # disabled
divdist_4 = DivideDistance(Curve=crv_13, Distance=distance_between_points_mm_2)  # -> simplify(Points), Tangents, Parameters; disabled
path_mapper_4 = PathMapper(divdist_4.Points, source="{a}", target="{1;a}")  # disabled

# ----
volume = Volume(Geometry=extrude)  # -> Volume, Centroid; disabled
scale_3 = Scale(Geometry=extrude, Center=volume.Centroid, Factor=1.01)  # -> Geometry, Transform; disabled
lng_7 = ListLength(List=path_mapper_4)  # disabled
repeat_5 = RepeatData(Data=bool, Length=lng_7)  # disabled
trim = TrimTree(Tree=repeat_5, Depth=2)  # disabled

ghpython_script_2 = GhPythonScript(breps=scale_3.Geometry, pts=divide_length_2.Points)  # -> out, pts; inputs breps: list of Brep, pts: list of Point3d; disabled
# ---------- ghpython_script_2: Python ----------
__author__ = "admin"
__version__ = "2019.11.12"
import Rhino.Geometry as rg

new_pts = []

for i, brep in enumerate(breps):
    for j in range(len(pts)):
        check = breps[i].IsPointInside(pts[j],0.01, False)
        if check == True:
            new_pts.append(pts[j])
            
for i in range(len(new_pts)):
    if new_pts[i] in pts:
        pts.remove(new_pts[i] )
# ---------- end ghpython_script_2 ----------
point_10 = Point(simplify(ghpython_script_2.pts))  # disabled

xy_4 = XYPlane(Origin=point_10)  # disabled
path_mapper_5 = PathMapper(pln, source="{a}", target="{2;a}")  # disabled
path_mapper_6 = PathMapper(xy_4, source="{a}", target="{0;a}")  # disabled
merge_12 = Merge(Data1=path_mapper_6, Data2=path_mapper_5)  # disabled

# ---- group: Travel on longer moves
# Travel on longer moves for base
python_2 = GhPythonScript(points=path_mapper_6)  # -> out, distance_next_pt; inputs points: list of Point3d; disabled
# ---------- python_2: Python ----------
__author__ = "tetov"
__version__ = "2019.11.14"

import Rhino.Geometry as rg

distances = []

for i, pt in enumerate(points):
    if i != len(points)-1:
        dist = pt.DistanceTo(points[i+1])
        
    else:
        dist = pt.DistanceTo(points[1])
    distances.append(dist)
        
distance_next_pt = distances
# ---------- end python_2 ----------
num = Number(python_2.distance_next_pt)  # disabled
larger = LargerThan(FirstNumber=num, SecondNumber=expr("x*2", distance_between_points_mm_2))  # -> LargerThan, OrEqualTo; disabled
shift = ShiftList(List=larger.LargerThan, Shift=-1, WTrue=True)  # -> flatten(List); disabled

# ----
# Travel first & last for tubes
panel_20 = Panel("0")  # disabled
panel_21 = Panel("1")  # disabled
lng_8 = ListLength(List=path_mapper_5)  # disabled
bool_6 = Boolean(panel_20)  # disabled
panel_22 = Panel("{0}")  # disabled
bool_7 = Boolean(panel_21)  # disabled
repeat_6 = RepeatData(Data=bool_6, Length=lng_8)  # -> simplify(Data); disabled
lng_9 = ListLength(List=repeat_6)  # -> expr("x-1", Length); disabled
panel_23 = Panel("0")  # disabled
lng_10 = ListLength()  # -> expr("x-1", Length); disabled
ins_3 = InsertItems(List=lng_9, Item=panel_23, Indices=0, WTrue=True)  # disabled
replace_2 = ReplaceItems(Item=bool_7, Indices=lng_10, WTrue=True)  # disabled
replace_3 = ReplaceItems(List=repeat_6, Item=bool_7, Indices=ins_3, WTrue=True)  # -> simplify(List); disabled
trim_2 = TrimTree(Tree=replace_2, Depth=1)  # disabled
merge_13 = Merge(Data1=trim_2, Data2=simplify(replace_3))  # -> flatten(Result); disabled
path_mapper_7 = PathMapper(merge_13, source="{a}", target="{a+2}")  # disabled

merge_14 = Merge(Data1=path_mapper_4, Data2=merge_12)  # disabled
trim_3 = TrimTree(Tree=merge_14, Depth=1)  # disabled

# ---- group: Output travel
merge_15 = Merge(Data1=simplify(shift), Data2=path_mapper_7, Data3=trim)  # disabled

# ---- group: Output geo
pln_2 = Plane(trim_3)  # disabled

# ----
# Setup height
number_slider_30 = Slider(40, range=0..40)
Z_3 = UnitZ(Factor=number_slider_30)
move_12 = Move(Geometry=flatten(split_6.ListB), Motion=Z_3)  # -> Geometry, Transform

# ---- group: Fabrication planes
pln_3 = Plane(flatten(move_12.Geometry))

# ----
pln_4 = Plane(flatten(pln_3))
rotate_10 = Rotate(Geometry=pln_4, Angle=degrees(Slider(135, range=-360..360)), Plane=pln_4)  # -> Geometry, Transform

# ---- group: Create commands
safe_speed = Slider(25, range=0..300)
speed = Slider(25, range=0..300)
planes_wcs = Plane(rotate_10.Geometry)
python_3 = PythonScript(
    planes_WCS=planes_wcs,
    travel=flatten(cull_i_2),
    dfillet=Slider(50, range=0..100),
    speed=speed,
    safe_speed=safe_speed,
    safe_pt=rotate_2.Geometry)  # -> commands; inputs planes_WCS: list of Plane, travel: list, speed: Int32, safe_pt: Plane
# ---------- python_3: Python ----------
import Rhino.Geometry as rg
from compas.geometry import Frame
from compas.geometry import Transformation
from scriptcontext import sticky as st


robot = st["robot"]
import Rhino.Geometry as rg
from compas.geometry import Frame
from compas.geometry import Transformation
from scriptcontext import sticky as st


robot = st["robot"]
buffer = 0.5

commands = []

def generate_cmds(planes_WCS, travel, dfillet, speed, safe_speed, safe_pt):

    # add safe_pt as a starting point
    tcp_WCS_safe_pt = Frame(safe_pt.Origin, safe_pt.XAxis, safe_pt.YAxis)

    tcp_RCS_safe_pt = robot.get_frame_in_RCS(tcp_WCS_safe_pt)
    cmd_safe_pt = list(tcp_RCS_safe_pt.point) + tcp_RCS_safe_pt.axis_angle_vector + [safe_speed, 0, True]
    commands.append(cmd_safe_pt)


    # TODO this must be optimized! matrix multiplication!

    for i, plane_WCS in enumerate(planes_WCS):
        tcp_WCS = Frame(plane_WCS.Origin, plane_WCS.XAxis, plane_WCS.YAxis)
        if i == 0 or i == len(planes_WCS) - 1:
            radius = 0.

        else:
            # calculate blend radius
            prev, current, next = planes_WCS[i-1].Origin, planes_WCS[i].Origin, planes_WCS[i+1].Origin
            # print((prev - current).Length/2 * buffer, (next - current).Length/2 * buffer, dfillet)
            radius = min((prev - current).Length/2 * buffer, (next - current).Length/2 * buffer, dfillet)
            radius = round(radius,5)
        print(radius)
        # print()


        tcp_RCS = robot.get_frame_in_RCS(tcp_WCS)
        cmd = list(tcp_RCS.point) + tcp_RCS.axis_angle_vector + [speed, radius, travel[i]]

        commands.append(cmd)


    # add safe_pt as an end point
    commands.append(cmd_safe_pt)
    return commands

if len(travel) in range(0,1):
    travel = [False] * len(planes_WCS)
elif len(travel) != len(planes_WCS):
    raise ValueError('Mismatch between numbers of planes and travel booleans')

commands = generate_cmds(planes_WCS, travel, dfillet, speed, safe_speed, safe_pt)

print commands[0]
# ---------- end python_3 ----------

py_2 = PythonScript()  # -> path
# ---------- py_2: Python ----------
import sys
import os

ghComp = ghenv.Component
ghDoc = ghComp.OnPingDocument()

# the full path of the gh file
path = ghDoc.FilePath
# the directory of the gh file
path = os.path.dirname(path)

path = os.path.abspath(os.path.join(path, ".."))

print path
# ---------- end py_2 ----------
continue_fabrication = BooleanToggle(True)
panel_24 = Panel(py_2)
save_json = Button()
start_safe_pt = BooleanToggle(False)
commands = Data(python_3)
send_9 = PythonScript(
    path=panel_24,
    continue_fabrication=continue_fabrication,
    commands=commands,
    start_at_safe_pt=start_safe_pt,
    save_json=save_json,
    name_json="commands_group_04.json")  # -> out; inputs continue_fabrication: Int32, commands: list, start_at_safe_pt: Boolean
# ---------- send_9: Python ----------
import json
import os

from mini_eggshell.ur_online_control.communication.msg_identifiers import *
from mini_eggshell.ur_online_control.utilities.lists import flatten_list
from time import sleep

#number of values per command to be formatted 
len_command = len(commands[0])
gh_commands = flatten_list(commands)


#to print in gh panel
print len_command, "values each command"
print len(gh_commands)/len_command, "commands." , len(gh_commands), "values"

if start_at_safe_pt is None: start_at_safe_pt = True

if start_at_safe_pt:
    print "Starting at safe point"
else:
    print "Starting at first frame of geometry"


data = {}
data['start_at_safe_pt'] = start_at_safe_pt
data['len_command'] = len_command
data['gh_commands'] = gh_commands


filename = os.path.join(path, name_json)
if save_json:
    with open(filename, 'w') as f:
        json.dump(data, f)
# ---------- end send_9 ----------

# 3
# 1
pln_5 = Plane(planes_wcs)
panel_25 = Panel(send_9)
item_6 = ListItem(List=pln_5, Index=0, WTrue=True)  # -> Item1, Item, Item1_2
merge_16 = Merge(Data1=rotate_2.Geometry, Data2=pln_5)
pln_6 = Plane([item_6.Item, item_6.Item1_2])

# ---- group: Check planes and travel
dispatch_2 = Dispatch(List=rotate_10.Geometry, DispatchPattern=flatten(cull_i_2))  # -> ListA, ListB
preview = CustomPreview(Geometry=dispatch_2.ListB, Material=ColourSwatch(SwatchColor=RGB(0, 98, 255)))
order_2 = PointOrder(Points=rotate_10.Geometry)
preview_2 = CustomPreview(Geometry=dispatch_2.ListA, Material=ColourSwatch(SwatchColor=RGB(0, 255, 111)))

# ---- group: Send commands / Send joint position directly to robot
panel_26 = Panel("move cartesian")
idx = Slider(0, range=0..100)
commands_2 = Data(python_3)
item_7 = ListItem(List=commands_2, Index=idx, WTrue=True)
list_4 = ValueList({"send all positions": 0, "send only one position": 1}, selected="send only one position")
filter = StreamFilter(Gate=list_4, Stream0=commands_2, Stream1=item_7)
movel_4 = PythonScript(commands=filter, velocity=Slider(100, range=0..100))  # -> script; inputs commands: list
# ---------- movel_4: Python ----------
from scriptcontext import sticky as st

script_lines = []
for cmd in commands:
    #q, a=1.4, v=1.05, t=0, r=0)
    x, y, z, ax, ay, az, speed, radius = cmd
    script_lines.append("movel(p%s, v=%f, r=%f)" % (str([x/1000., y/1000., z/1000, ax, ay, az]), speed/1000., radius/1000.))

robot = st["robot"]
tool_angle_axis = list(robot.tool.tcp_frame.point) + robot.tool.tcp_frame.axis_angle_vector
x, y, z, ax, ay, az = tool_angle_axis

script = "def prog():\n"
script += "\ttextmsg(\">> program start\")\n"
script += "\tset_tcp(p%s)\n" % str([x/1000., y/1000., z/1000, ax, ay, az])
script += "".join(["\t%s\n" % line for line in script_lines])
script += "\ttextmsg(\"<< program end\")\n"
script += "end\n"
script += "prog()\n\n"

print script
# ---------- end movel_4 ----------
send_10 = Button()
send_11 = Send(script=movel_4, send=send_10)
panel_27 = Panel(send_11)

# ----
# Settings
# 1. load robot model
# 2. set tool
# 3. set basis
# 1. load robot model
# 2. set tool
# 3. set basis
nozzle_distance_from_holder = Slider(50.7, range=0..100)
list_5 = ValueList({"no_tool": 0, "plastic_extruder": 1, "clay_extruder": 2, "clay_extruder_SS": 3, "clay_extruder_SS_alu": 4}, selected="clay_extruder_SS")
base_2 = PythonScript()  # -> base_frame, base
# ---------- base_2: Python ----------
from compas.geometry import Frame

"""
origin = [0, 0, 0]
xaxis = [1, 0, 0]
yaxis = [0, 1, 0]


origin = [-313.92, -147.58, 13.79]
xaxis = [0.00000, -1.00000, 0.00000]
yaxis = [1.00000, 0.00000, 0.00000]
"""

#axis    Y         Z                        X

origin = [-14.89, -373.34, -469.74]
xaxis = [-0.00473, -0.99998, -0.00304]
yaxis = [0.99998, -0.00474, 0.00418]

base_frame = Frame(list(origin), list(xaxis), list(yaxis))

base = "base = " + str(origin) + "\n"
# ---------- end base_2 ----------
panel_28 = Panel(base_2.base)
list_6 = ValueList({"UR5", "UR10"}, selected="UR5")

subtraction = Subtraction(A=nozzle_distance_from_holder, B=number_slider_30)

tools = Tools(tool_id=list_5, nozzle_distance_from_holder=subtraction)
robot = PythonScript(model=list_6, tool=tools, base_frame=base_2.base_frame)  # -> robot
# ---------- robot: Python ----------
from mini_eggshell.ur_online_control.ur.ur10 import UR10
from mini_eggshell.ur_online_control.ur.ur5 import UR5
from scriptcontext import sticky as st

if model == "UR5":
    robot = UR5()
elif model == "UR10":
    robot = UR10()

if tool:
    robot.set_tool(tool)
if base_frame:
    robot.set_base(base_frame)

st["robot"] = robot
# ---------- end robot ----------

# ----
# 2
# Visualisation
planes_wcs_2 = Plane(pln_6)
robot_2 = Data(robot)
pose_joints = Data(pose_2)

# ----
# Add init joint states
joint_states = Data([-0.1728179112, -1.415058186, 1.813991282, -1.971940356, -1.571654205, -3.308720436])
init_configuration = Slider(2, range=0..7)
py_3 = PythonScript(robot=robot_2, planes_WCS=planes_wcs_2, configuration_idx=init_configuration, init_configuration=joint_states)  # -> configurations; inputs planes_WCS: list, configuration_idx: Int32, init_configuration: list
# ---------- py_3: Python ----------
from compas_ghpython import unload_modules
unload_modules('ur_online_control')
import Rhino.Geometry as rg
from compas.geometry import Frame 
from compas.geometry.xforms import Transformation
#from compas_ghpython import xdraw_frame
from ur_online_control.ur.kinematics import calculate_configurations_for_path, format_joint_positions


# TODO this must be optimized! matrix multiplication!
frames_tool0_RCS = []
for plane_WCS in planes_WCS:
    tcp_WCS = Frame(plane_WCS.Origin, plane_WCS.XAxis, plane_WCS.YAxis)
    tcp_RCS = robot.get_frame_in_RCS(tcp_WCS)
    frames_tool0_RCS.append(robot.get_tool0_frame_from_tcp_frame(tcp_RCS))
    

#configurations = calculate_configurations_for_path(frames_tool0_RCS, robot.params, init_configuration)
configurations = calculate_configurations_for_path(frames_tool0_RCS, robot, init_configuration)
print configurations
configurations = configurations[min([configuration_idx, len(configurations) - 1])]

def format(numbers, k=4):
    #numbers = format_joint_positions(numbers)
    return "[" + ", ".join([("%." + str(k) + "f") % n for n in numbers]) + "]"
# ---------- end py_3 ----------
start = Button()
stop_3 = Button()
step = Button()
back = Button()
reset = Button()
counter = CountThroughList(L=py_3, start=start, stop=stop_3, step=step, step_back=back, reset=reset, interval=50)  # -> item; inputs L: list, start: Boolean, stop: Boolean, step_back: Boolean
# ---------- counter: Python ----------
from scriptcontext import sticky as st
from compas_ghpython import update_component


# store data in component
guid = str(ghenv.Component.InstanceGuid)
counter_key = "counter_" + guid
running_key = "running_" + guid

if counter_key not in st:
    st[counter_key] = 0

if running_key not in st:
    st[running_key] = False

if start:
    st[running_key] = True

if stop:
    st[running_key] = False

if step:
    if st[counter_key] < len(L) - 1:
        st[counter_key] += 1

if step_back:
    if st[counter_key] < len(L) - 1:
        st[counter_key] -= 1

if reset:
    st[counter_key] = 0

if len(L):
    item = L[st[counter_key]]

if st[running_key]:
    if st[counter_key] < len(L) - 1:
        st[counter_key] += 1
        update_component(ghenv, interval)
    else:
        st[counter_key] = 0
        st[running_key] = False
# ---------- end counter ----------

pt_13 = Point(Point(-283.8412985, -342.877576, 297.4189147))
select_configuration = Slider(1, range=0..7)
xy_5 = XYPlane(Origin=pt_13)
plane_wcs = Plane(xy_5)
inverse = PythonScript(robot=robot_2, plane_WCS=plane_wcs, idx=select_configuration)  # -> configuration; inputs plane_WCS: Plane, idx: Int32
# ---------- inverse: Python ----------
import Rhino.Geometry as rg
from compas.geometry import Frame, Transformation
#from compas_ghpython import xdraw_frame

tcp_WCS = Frame(plane_WCS.Origin, plane_WCS.XAxis, plane_WCS.YAxis)

# transform frame to robot coordinate system
tcp_RCS = robot.get_frame_in_RCS(tcp_WCS)

# get the frame of tool0
tool0_RCS = robot.get_tool0_frame_from_tcp_frame(tcp_RCS)

# calculate solutions to frame
solutions = robot.inverse_kinematics(tool0_RCS)

if not len(solutions):
    q = [0,0,0,0,0,0]
else:
    idx = min(len(solutions) - 1, idx)
    q = solutions[idx]
    
print q

configuration = q
# ---------- end inverse ----------

# ---- group: Shows joint positions along path
flip = BooleanToggle(True)
l2t = PythonScript(L=py_3, flip=flip)  # -> T; inputs L: list, flip: Boolean
# ---------- l2t: Python ----------
from compas_ghpython import list_to_ghtree
L = [l.joint_values for l in L]

if flip:
    L = zip(*L)
T = list_to_ghtree(L)
# ---------- end l2t ----------
graph = QuickGraph(l2t, SortOrder=0)

# ---- group: robot model brep
py_4 = PythonScript(model=list_6)  # -> n
# ---------- py_4: Python ----------
if model == "UR5":
    n = 0
if model == "UR10":
    n = 1

print n
# ---------- end py_4 ----------
ur10_brep = UR10Brep([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])
ur5_brep = UR5Brep([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])
show_brep = BooleanToggle(False)
filter_2 = StreamFilter(Gate=py_4, Stream0=ur5_brep, Stream1=ur10_brep)

# ----
py_5 = GhPythonScript(joint_values=ur1_q1_q6)  # -> configuration; inputs joint_values: list
# ---------- py_5: Python ----------
import math
from ur_online_control.ur.robot import BaseConfiguration

configuration = BaseConfiguration.from_joints([math.radians(d) for d in joint_values])
# ---------- end py_5 ----------
list_7 = ValueList({"0 forward, from angles": 0, "1 inverse, from one plane": 1, "2 inverse, from multiple planes": 2, "3 forward, from robot": 3}, selected="2 inverse, from multiple planes")
filter_3 = StreamFilter(Gate=list_7, Stream0=py_5, Stream1=inverse, Stream2=counter, Stream3=pose_joints)
configuration = Panel(filter_3)
mesh_3 = Mesh(filter_2)
draw = PythonScript(robot=robot_2, configuration=filter_3, mesh=mesh_3, brep=filter_2, show_brep=show_brep)  # -> meshes, tool0_plane, tcp_plane, robot_brep; inputs mesh: list, brep: list
# ---------- draw: Python ----------
from compas_ghpython import unload_modules
unload_modules("ur_online_control")

#from compas_ghpython import xdraw_frame
from compas_ghpython import mesh_draw
from compas_ghpython.geometry.xforms import xform_from_transformation
from compas.geometry import Frame
from compas.geometry.xforms import Transformation
from mini_eggshell.ur_online_control.ur.robot import BaseConfiguration

import Rhino.Geometry as rg
import Rhino

def mesh_update_vertices(mesh, vertices):
    for i in range(len(vertices)):
        mesh.vertex[i].update({'x': vertices[i][0], 'y': vertices[i][1], 'z': vertices[i][2]})

if configuration:
    #print configuration
    #q = BaseConfiguration.from_joints(configuration)
    q = configuration
    print q
    print q.joint_values
    
    print robot.get_forward_transformations(q)
    R0, R1, R2, R3, R4, R5 = robot.get_forward_transformations(q)
    
    tool0_frame2 = robot.tool0_frame.transformed(R5)
    tcp_frame2 = Frame.from_transformation(Transformation.from_frame(tool0_frame2) * robot.transformation_tool0_tcp)
    
    print robot.transformation_tool0_tcp
    print robot.transformation_tcp_tool0
    print robot.transformation_tool0_tcp * robot.transformation_tcp_tool0
    print tcp_frame2
    tcp_frame2 = Frame.from_transformation(Transformation.from_frame(tool0_frame2) * robot.transformation_tcp_tool0)
    print tcp_frame2
    
    tool0_frame, tcp_frame = robot.get_transformed_tool_frames(R5)
    
    tool0_frame = tool0_frame2
    tcp_frame = tcp_frame2
    
    m0, m1, m2, m3, m4, m5 = mesh
    for i in range(6):
        exec("R%drg = xform_from_transformation(R%d)" % (i, i))
        exec("m%d.Transform(R%drg)" % (i, i))
    meshes = [m0, m1, m2, m3, m4, m5]
    print meshes
    mt = robot.tool.get_transformed_model(Transformation.from_frame(tool0_frame))
    
    if mt:
        meshes.extend(map(mesh_draw, mt))
    
    """
    m0, m1, m2, m3, m4, m5, tool0_frame, tcp_frame = robot.get_transformed_model(q)
    mt = robot.get_transformed_tool_model(tcp_frame)
    
    meshes = []
    meshes.append(mesh_draw(m0))
    meshes.append(mesh_draw(m1))
    meshes.append(mesh_draw(m2))
    meshes.append(mesh_draw(m3))
    meshes.append(mesh_draw(m4))
    meshes.append(mesh_draw(m5))
    if mt:
        meshes.append(mesh_draw(mt))
    
    """
    
#    tool0_plane = xdraw_frame(tool0_frame)
#    tcp_plane = xdraw_frame(tcp_frame)
    
    if show_brep:
        
        b0, b1, b2, b3, b4, b5 = brep
        
        b0.Transform(R0rg)
        b1.Transform(R1rg)
        b2.Transform(R2rg)
        b3.Transform(R3rg)
        b4.Transform(R4rg)
        b5.Transform(R5rg)
        
        robot_brep = [b0, b1, b2, b3, b4, b5]
# ---------- end draw ----------
robot_brep = Brep(draw.robot_brep)
tool0_plane = Plane(draw.tool0_plane)
tcp_plane = Plane(draw.tcp_plane)
draw_2 = RepresentPlaneAsLines(plane=tcp_plane, size=100)  # -> G, C
# ---------- draw_2: Python ----------
import Rhino.Geometry as rg
from System.Drawing import Color

if plane:

    G = []
    G.append(rg.Line(plane.Origin, size * plane.XAxis))
    G.append(rg.Line(plane.Origin, size * plane.YAxis))
    G.append(rg.Line(plane.Origin, size * plane.ZAxis))
    
    C = []
    C.append(Color.FromArgb(255, 0, 0))
    C.append(Color.FromArgb(0, 255, 0))
    C.append(Color.FromArgb(0, 0, 255))
# ---------- end draw_2 ----------
preview_3 = CustomPreview(Geometry=draw_2.G, Shader=draw_2.C)
preview_4 = CustomPreview(Geometry=draw.meshes, Shader=ColourSwatch(SwatchColor=RGBA(99, 94, 94, 96)))

mesh_4 = Mesh(draw.meshes)
item_8 = ListItem(List=mesh_4, Index=-1, WTrue=True)
bbox = BoundingBox(Content=mesh_4, PWorldXY=PlaneXY(0, 0, 0), UnionBox=True)  # -> Box, Box_2
debox = DeconstructBox(Box=bbox.Box)  # -> Plane, X, Y, Z
panel_29 = Panel(debox.Z)

# ---- group: Send commands / Send joint position directly to robot
idx_2 = Slider(0, range=0..100)
panel_30 = Panel("move joints")
joint_positions = Data(py_3)
list_8 = ValueList({"send all positions": 0, "send only one position": 1}, selected="send only one position")
item_9 = ListItem(List=joint_positions, Index=idx_2, WTrue=True)
filter_4 = StreamFilter(Gate=list_8, Stream0=joint_positions, Stream1=item_9)
movej = PythonScript(joint_positions=filter_4, velocity=Slider(153, range=0..200))  # -> script; inputs joint_positions: list
# ---------- movej: Python ----------
script_lines = []

for position in joint_positions:
    script_lines.append("movej(%s, v=%f)" % (str(position), velocity/1000.))


script = "def prog():\n"
script += "\ttextmsg(\">> program start\")\n"
script += "".join(["\t%s\n" % line for line in script_lines])
script += "\ttextmsg(\"<< program end\")\n"
script += "end\n"
script += "prog()\n\n"


print script

#script = ""
# ---------- end movej ----------
send_12 = Button()

# ---- group: Send commands
send_13 = Send(script=movej, send=send_12)

# ---- group: Send commands / Send joint position directly to robot (continued)
panel_31 = Panel(send_13)

# ==== cluster Send
script = ClusterInput()
send = ClusterInput()
send_2 = PythonScript(script=script, send=send)  # -> out
# ---------- send_2: Python ----------
import socket
from scriptcontext import sticky as st

ur_ip = st['ur_ip']
ur_port = 30002

if send:
    s = socket.create_connection((ur_ip, ur_port), timeout=0.5) 
    s.send(script)
    s.close()
# ---------- end send_2 ----------
out = ClusterOutput(send_2)

# ==== cluster Tools
nozzle_distance_from_holder = ClusterInput()
tool_id = ClusterInput()
number_slider = Slider(180, range=0..1000)

# ---- group: plastic_extruder
brep = Brep([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])
xaxis_line = Curve(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)
yaxis_line = Curve(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)
test_geometry = Geometry(brep)
mesh = Mesh(test_geometry)
brep_2 = Brep(test_geometry)
tool = Tool(meshes=mesh, breps=brep_2, G=xaxis_line, G_2=yaxis_line)

# ---- group: no_tool
brep_3 = Brep(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)
yaxis_line_2 = Curve(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)
xaxis_line_2 = Curve(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)
test_geometry_2 = Geometry(brep_3)
mesh_2 = Mesh(test_geometry_2)
brep_4 = Brep(test_geometry_2)
tool_2 = Tool(meshes=mesh_2, breps=brep_4, G=xaxis_line_2, G_2=yaxis_line_2)

# ---- group: clay_extruder
brep_5 = Brep([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])
yaxis_line_3 = Curve(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)
xaxis_line_3 = Curve(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)
test_geometry_3 = Geometry(brep_5)
mesh_3 = Mesh(test_geometry_3)
brep_6 = Brep(test_geometry_3)
tool_3 = Tool(meshes=mesh_3, breps=brep_6, G=xaxis_line_3, G_2=yaxis_line_3)

# ---- group: clay_extruder_SS
brep_7 = Brep([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])
yaxis_line_4 = Curve(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)
xaxis_line_4 = Curve(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)
test_geometry_4 = Geometry(brep_7)
mesh_4 = Mesh(test_geometry_4)
brep_8 = Brep(test_geometry_4)
tool_4 = Tool(meshes=mesh_4, breps=brep_8, G=xaxis_line_4, G_2=yaxis_line_4, nozzle_distance_from_holder=nozzle_distance_from_holder)

# ----
tool_id_2 = Integer(tool_id)

# ---- group: clay_extruder_SS_alu_can
brep_9 = Brep([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])
xaxis_line_5 = Curve(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)
yaxis_line_5 = Curve(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)

# ----
rotate = Rotate(Geometry=brep_9, Angle=degrees(number_slider), Plane=PlaneXY(0, 0, 0))  # -> Geometry, Transform
rotate_2 = Rotate(Geometry=xaxis_line_5, Angle=degrees(number_slider), Plane=PlaneXY(0, 0, 0))  # -> Geometry, Transform
rotate_3 = Rotate(Geometry=yaxis_line_5, Angle=degrees(number_slider), Plane=PlaneXY(0, 0, 0))  # -> Geometry, Transform

# ---- group: clay_extruder_SS_alu_can (continued)
test_geometry_5 = Geometry(rotate.Geometry)
mesh_5 = Mesh(test_geometry_5)
brep_10 = Brep(test_geometry_5)
tool_5 = Tool(
    meshes=mesh_5,
    breps=brep_10,
    G=rotate_2.Geometry,
    G_2=rotate_3.Geometry,
    nozzle_distance_from_holder=nozzle_distance_from_holder)

# ----
filter = StreamFilter(Gate=tool_id_2, Stream1=tool, Stream2=tool_3, Stream3=tool_4, Stream4=tool_5)
py = PythonScript(tool=filter)  # -> tcp_frame, model
# ---------- py: Python ----------
from compas_ghpython import mesh_draw 

tcp_frame = tool.tcp_frame
model = map(mesh_draw, tool.model)
# ---------- end py ----------
tool_6 = Data(filter)
draw = PythonScript(frame=py.tcp_frame)  # -> G, C
# ---------- draw: Python ----------
import Rhino.Geometry as rg
from System.Drawing import Color

if not size:
    size = 100

if frame:
    plane = rg.Plane(rg.Point3d(*list(frame.point)), rg.Vector3d(*list(frame.xaxis)), rg.Vector3d(*list(frame.yaxis)))

    G = []
    G.append(rg.Line(plane.Origin, size * plane.XAxis))
    G.append(rg.Line(plane.Origin, size * plane.YAxis))
    G.append(rg.Line(plane.Origin, size * plane.ZAxis))
    
    C = []
    C.append(Color.FromArgb(255, 0, 0))
    C.append(Color.FromArgb(0, 255, 0))
    C.append(Color.FromArgb(0, 0, 255))
# ---------- end draw ----------
tool_7 = ClusterOutput(tool_6)
preview = CustomPreview(Geometry=draw.G, Shader=draw.C)
preview_2 = CustomPreview(Geometry=py.model, Shader=ColourSwatch(SwatchColor=RGB(141, 170, 178)))

# ==== cluster Tool
nozzle_distance_from_holder = ClusterInput()
meshes = ClusterInput()
breps = ClusterInput()
G = ClusterInput()
G_2 = ClusterInput()
subtraction = Subtraction(A=nozzle_distance_from_holder, B5085=50.85)
null = NullItem(Item=nozzle_distance_from_holder)  # -> NullFlags, InvalidFlags, Description
filter = StreamFilter(Gate=null.NullFlags, Stream0=subtraction, Stream1="0")
Z = UnitZ(Factor=filter)
meshes_2 = Mesh(meshes)
mjoin = MeshJoin(Meshes=meshes_2)
move = Move(Geometry=G_2, Motion=Z)  # -> Geometry, Transform
move_2 = Move(Geometry=G, Motion=Z)  # -> Geometry, Transform
tool = PythonScript(meshes=mjoin, breps=breps, xline=move_2.Geometry, yline=move.Geometry)  # -> tool; inputs meshes: list of Mesh, breps: list of Brep
# ---------- tool: Python ----------
import Rhino.Geometry as rg
from compas.geometry import Frame
from ur_online_control.ur.tool import Tool
from compas.datastructures import Mesh
from compas_rhino.helpers import mesh_from_guid

xaxis = rg.Line(xline.PointAtStart, xline.PointAtEnd)
yaxis = rg.Line(yline.PointAtStart, yline.PointAtEnd)

if xaxis.From.DistanceTo(yaxis.From) < 0.01:
    origin = xaxis.From
    xaxis = xaxis.Direction
    yaxis = yaxis.Direction
elif xaxis.To.DistanceTo(yaxis.To) < 0.01:
    origin = xaxis.To
    xaxis = -xaxis.Direction
    yaxis = -yaxis.Direction
elif xaxis.From.DistanceTo(yaxis.To) < 0.01:
    origin = xaxis.From
    xaxis = xaxis.Direction
    yaxis = -yaxis.Direction
elif xaxis.To.DistanceTo(yaxis.From) < 0.01:
    origin = xaxis.To
    xaxis = -xaxis.Direction
    yaxis = yaxis.Direction

xaxis.Unitize()
yaxis.Unitize()

print origin
print xaxis
print yaxis

tcp_frame = Frame(origin, xaxis, yaxis)

tool = Tool(tcp_frame)
tool.model = [mesh_from_guid(Mesh, mesh) for mesh in meshes]
#tool.model_xyz = tool.model.xyz
tool.breps = breps
# ---------- end tool ----------
tool_2 = ClusterOutput(tool)
